# Grasshopper definition Shadedefinition copy.gh (Grasshopper 0.9.80)

curve = Curve(<curve referenced from the Rhino model>)
curve_2 = Curve(<curve referenced from the Rhino model>)
curve_3 = Curve(<curve referenced from the Rhino model>)
loft = Loft(
    Curves=[curve, curve_2, curve_3],
    Options={Adjust=False, Closed=False, LoftEnds=0, LoftSimp=0, LoftType=3, Rebuild=10, Refit=0.01})
deconstruct_brep = DeconstructBrep(Brep=loft)  # -> Faces, Edges, Vertices
panel = Panel(deconstruct_brep.Faces)
list_item = ListItem(List=deconstruct_brep.Faces, Index=Slider(0, range=0..10), Wrap=True)
u_count = Slider(1, range=0..10)
v_count = Slider(132, range=0..300)
list_item_2 = ListItem(List=deconstruct_brep.Faces, Index=Slider(1, range=0..10), Wrap=True)
surface = Surface(reparameterize(list_item))
surface_2 = Surface(reparameterize(list_item_2))
panel_2 = Panel(surface_2)
divide_domain² = DivideDomain²(Domain=surface_2, UCount=u_count, VCount=v_count)
isotrim = Isotrim(Surface=surface_2, Domain=divide_domain²)
divide_domain²_2 = DivideDomain²(Domain=surface_2, UCount=u_count, VCount=v_count)
isotrim_2 = Isotrim(Surface=surface, Domain=divide_domain²_2)
merge = Merge(Data1=Toggle(True), Data2=Toggle(False))
cull_pattern = CullPattern(List=isotrim_2, CullPattern=merge)
cull_pattern_2 = CullPattern(List=isotrim, CullPattern=merge)
merge_2 = Merge(Data1=cull_pattern_2, Data2=cull_pattern)
